# Grasshopper definition gridfinity.ghx (Grasshopper 1.0.7)
# plug-ins: Pufferfish

height_multiples_of_7 = Slider(3, range=0..10)
height_multiples_of_7_2 = Slider(4, range=0..10)
x_count = Slider(4, range=0..10)
y_count = Slider(4, range=0..10)
height_of_bottom = Slider(2, range=0..10)
fillet_radius = Slider(4, range=0..10)
height_divider_mm = GetNumber(height_multiples_of_7, AtLeast=1, AtMost=1, Maximum=1.797693135e+308, Minimum=-1.797693135e+308)
height_total_mm = GetNumber(height_multiples_of_7_2, AtLeast=1, AtMost=1, Maximum=1.797693135e+308, Minimum=-1.797693135e+308)
x_count_2 = GetNumber(x_count, AtLeast=1, AtMost=1, Maximum=1.797693135e+308, Minimum=-1.797693135e+308)
y_count_2 = GetNumber(y_count, AtLeast=1, AtMost=1, Maximum=1.797693135e+308, Minimum=-1.797693135e+308)
height_bottom_surface_mm = GetNumber(height_of_bottom, AtLeast=1, AtMost=1, Maximum=1.797693135e+308, Minimum=-1.797693135e+308)

multiplication = Multiplication(A="7", B=height_total_mm)

# ---- group: Divider
divider = Curve(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)
x_minus_one = XMinusOne(NumberX=height_total_mm)
multiplication_2 = Multiplication(A="7", B=x_minus_one)
Z = UnitZ(Factor=multiplication_2)
extr = Extrude(Base=divider, Direction=Z)
cap = CapHoles(Brep=extr)

divider_2 = Curve(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)
x_minus_one_2 = XMinusOne(NumberX=height_total_mm)
multiplication_3 = Multiplication(A="7", B=x_minus_one_2)
Z_2 = UnitZ(Factor=multiplication_3)
extr_2 = Extrude(Base=divider_2, Direction=Z_2)
cap_2 = CapHoles(Brep=extr_2)

# ----
number_slider = Slider(42, range=0..100)
rectangle = Rectangle(Plane=PlaneXY(0, 0, 0), XSize=number_slider, YSize=number_slider, Radius=0)  # -> Rectangle, Length

# ---- group: -1 Count
x_minus_one_3 = XMinusOne(NumberX=y_count_2)
x_minus_one_4 = XMinusOne(NumberX=x_count_2)

# ---- group: Divider
divider_3 = Curve(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)
x_minus_one_5 = XMinusOne(NumberX=height_total_mm)
multiplication_4 = Multiplication(A="7", B=x_minus_one_5)
Z_3 = UnitZ(Factor=multiplication_4)
extr_3 = Extrude(Base=divider_3, Direction=Z_3)
cap_3 = CapHoles(Brep=extr_3)
arrrec = RectangularArray(Geometry=cap_3, Cell=rectangle.Rectangle, XCount=x_minus_one_4, YCount=x_minus_one_3)  # -> Geometry, Transform

# ----
base = Brep(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)
y_size_count = Multiplication(A=number_slider, B=y_count_2)
arrrec_2 = RectangularArray(Geometry=base, Cell=rectangle.Rectangle, XCount=x_count_2, YCount=y_count_2)  # -> flatten(Geometry), Transform
x_size_count = Multiplication(A=number_slider, B=x_count_2)
rectangle_2 = Rectangle(Plane=PlaneXY(0, 0, 0), XSize=x_size_count, YSize=y_size_count, Radius=fillet_radius)  # -> Rectangle, Length
arrrec_3 = RectangularArray(Geometry=cap, Cell=rectangle.Rectangle, XCount=x_count_2, YCount=x_minus_one_3)  # -> Geometry, Transform
arrrec_4 = RectangularArray(Geometry=cap_2, Cell=rectangle.Rectangle, XCount=x_minus_one_4, YCount=y_count_2)  # -> Geometry, Transform
top_cover_removal = TopCoverRemoval(A=number_slider, G=base, A_2=x_count_2, A_3=y_count_2)

# ---- group: Outside Edge
Z_4 = UnitZ(Factor="4.75")
move = Move(Geometry=rectangle_2.Rectangle, Motion=Z_4)  # -> Geometry, Transform

# ---- group: Bottom Piece Extrusion
Z_5 = UnitZ(Factor=height_bottom_surface_mm)
extr_4 = Extrude(Base=move.Geometry, Direction=Z_5)
cap_4 = CapHoles(Brep=extr_4)

# ---- group: Inside Edge - 1 Big Piece
subtraction = Subtraction(A="35.6", B=number_slider)
division = Division(A=subtraction, B="2")
offset = OffsetCurve(Curve=move.Geometry, Distance=division, Corners=1)

# ----
merge = Merge(Data1=move.Geometry, Data2=offset)

Z_6 = UnitZ(Factor=multiplication)
extr_5 = Extrude(Base=merge, Direction=Z_6)
cap_5 = CapHoles(Brep=extr_5)
bang = ExplodeTree(Data=cap_5)  # -> Branch0, Branch1
sdiff = SolidDifference(BrepsA=bang.Branch0, BrepsB=bang.Branch1)

Z_7 = UnitZ(Factor=multiplication)

# ---- group: Move up to Position
move_2 = Move(Geometry=top_cover_removal, Motion=Z_7)  # -> Geometry, Transform

# ----
sdiff_2 = SolidDifference(BrepsA=sdiff, BrepsB=move_2.Geometry)

# ---- group: gridfinity base
brep = Brep(arrrec_2.Geometry)

# ---- group: Bottom Piece
brep_2 = Brep(cap_4)

# ---- group: Outside Frame
brep_3 = Brep(sdiff_2)

# ---- group: Middle Star
brep_4 = Brep(arrrec.Geometry)

# ---- group: X Divider
brep_5 = Brep(arrrec_3.Geometry)

# ---- group: Y Divider
brep_6 = Brep(arrrec_4.Geometry)

# ----
merge_2 = Merge(Data1=flatten(brep), Data2=brep_2, Data3=flatten(brep_3), Data4=brep_4, Data5=brep_5, Data6=brep_6)

# ---- group: RH_OUT:Breps
brep_7 = Brep(merge_2)

# ==== cluster TopCoverRemoval
A = ClusterInput()
division = Division(A=A, B="2")
rectangle = Rectangle(Plane=PlaneXY(0, 0, 0), XSize=division, YSize=division, Radius=0)  # -> Rectangle, Length
A_2 = ClusterInput()
A_3 = ClusterInput()
multiplication = Multiplication(A=A_2, B="2")
multiplication_2 = Multiplication(A=A_3, B="2")
G = ClusterInput()
x_minus_one = XMinusOne(NumberX=multiplication_2)
x_minus_one_2 = XMinusOne(NumberX=multiplication)
arrrec = RectangularArray(Geometry=G, Cell=rectangle.Rectangle, XCount=x_minus_one_2, YCount=x_minus_one)  # -> flatten(Geometry), Transform
G_2 = ClusterOutput(arrrec.Geometry)
